% Simulink data dictionary GeneratedModel_20260122_181908_DataDict.sldd

SimpleAdditionModel_Y = Simulink.Parameter(0, DataType="double")
Output = Simulink.Parameter(0, DataType="double")
re = Simulink.Parameter(0, DataType="double")
im = Simulink.Parameter(0, DataType="double")