test file "testFile1"

suite "New Test Suite 1"

  case "New Test Case 1" [baseline]
    test data file: test1.xlsx
    model model_1, harness model_1_Harness1
    input "Sheet1" from test1.xlsx, mapped to In1, In2 (active)
    logged signals "Signal Set 1": Output Conversion Subsystem:1
    baseline "Sheet1"
      In1
      In2
      Out1
    custom criteria:
      % Get the logged input and output signals

      logs = test.sltest_simout.logsout;
      In1 = logs.getElement('In1');
      In2 = logs.getElement('In2');
      Out1 = logs.getElement('Out1');
      In1Data = In1.Values.Data;
      In2Data = In2.Values.Data;
      Out1Data = Out1.Values.Data;
      expectedOut1 = In1Data + In2Data;

      % Check if the actual output matches the expected output
      assert(isequal(Out1Data, expectedOut1), 'Out1 does not match the expected sum of In1 and In2.');

  case "New Test Case 2" [equivalence]
    simulation 1:
      model model_1, harness model_1_Harness1
    simulation 2:
      model model_1, harness model_1_Harness1
    equivalence criteria
      Out1
      In1
      In2
      Input Conversion Subsystem:1
      Input Conversion Subsystem:2
      Out1
      model_1:1